# Dynamo graph CreateTextLabels.dyn (Dynamo 2.5.2.7915)

createText = Python()
# ---------- createText.python (36 lines) ----------
import clr
clr.AddReference('ProtoGeometry')
from Autodesk.DesignScript.Geometry import Point


# Outputs arrays
Text_List = list()
Points_List = list()

#Ayxilary function
def GetOneCoordStr(value):
	if value<10:
		StrFinish = '0' + str(value)
	elif value<0:
		StrFinish = '00'
	else:
		StrFinish = str(value)
	return StrFinish

#Function to getting text value
def GetStrCoordFromNum (x_value,y_value):
	return str(GetOneCoordStr(x_value)) + str(GetOneCoordStr(y_value))

for CoordX in range(0,43):
	for CoordY in range(0,46):
		Text_List.append(GetStrCoordFromNum(CoordY,CoordX))
		OnePoint3D = Point.ByCoordinates(-2000+CoordX*4000,-2000+CoordY*4000,0)
		Points_List.append(OnePoint3D)
		CoordY+=1
	CoordX+=1

ToExport = list()
ToExport.append(Text_List)
ToExport.append(Points_List)
# Assign your output to the OUT variable.
OUT = ToExport
# ----------------------------------------
code_block = CodeBlock(b=createText) { b[0]; b[1]; }
code_block_2 = CodeBlock { 200; }
MTextHorizontalAttachment = HorizontalAttachment("По центру")
MTextVerticalAttachment = VerticalAttachment("Посередине")
code_block_3 = CodeBlock { "0"; }
current = Autodesk.AutoCAD.DynamoNodes.Document.Current()
blocks = Autodesk.AutoCAD.DynamoNodes.Document.Blocks(document=current)
code_block_4 = CodeBlock(a=blocks) { a[0]; }
create = Autodesk.AutoCAD.DynamoNodes.MText.Create(text=code_block.out0, insertionPoint=code_block.out1, height=code_block_2, horizontalAttachment=MTextHorizontalAttachment, verticalAttachment=MTextVerticalAttachment, layer=code_block_3, block=code_block_4)
watch = Watch(createText)
